# Grasshopper definition ChicagoInnovateHackathon_PullSensorData_NoNulls.ghx (Grasshopper 1.0.8)
# Copyright: Arup
# plug-ins: eleFront, Swiftlet

panel = Panel("""wifi
lux
temp
humid
gas
noise""")

value_list = ValueList({"wifi", "lux", "temp", "humid", "gas", "noise"}, selected="lux")
annotation_dot = AnnotationDot([<annotation dot referenced from the Rhino model> x13])
panel_2 = Panel("https://io.adafruit.com/api/v2/typevoid/feeds/voidsense{pod}.sense{pod}-{data}/data/chart")
text_split = TextSplit(Text=annotation_dot, Separators="()")
point = Point(annotation_dot)
list_item = ListItem(List=text_split, Index=1, Wrap=True)  # -> simplify(Item)
panel_3 = Panel(list_item)
replace_text = ReplaceText(Text=panel_2, Find="{data}", Replace=value_list, RecursiveReplace=False)
replace_text_2 = ReplaceText(Text=replace_text, Find="{pod}", Replace=panel_3, RecursiveReplace=False)

value_list_2 = ValueList({"wifi", "lux", "temp", "humid", "gas", "noise"}, selected="wifi")
annotation_dot_2 = AnnotationDot([<annotation dot referenced from the Rhino model> x13])
panel_4 = Panel("https://io.adafruit.com/api/v2/typevoid/feeds/voidsense{pod}.sense{pod}-{data}/data/chart")
text_split_2 = TextSplit(Text=annotation_dot_2, Separators="()")
point_2 = Point(annotation_dot_2)
list_item_2 = ListItem(List=text_split_2, Index=1, Wrap=True)  # -> simplify(Item)
panel_5 = Panel(list_item_2)
replace_text_3 = ReplaceText(Text=panel_4, Find="{data}", Replace=value_list_2, RecursiveReplace=False)
replace_text_4 = ReplaceText(Text=replace_text_3, Find="{pod}", Replace=panel_5, RecursiveReplace=False)

value_list_3 = ValueList({"wifi", "lux", "temp", "humid", "gas", "noise"}, selected="gas")
annotation_dot_3 = AnnotationDot([<annotation dot referenced from the Rhino model> x13])
panel_6 = Panel("https://io.adafruit.com/api/v2/typevoid/feeds/voidsense{pod}.sense{pod}-{data}/data/chart")
text_split_3 = TextSplit(Text=annotation_dot_3, Separators="()")
point_3 = Point(annotation_dot_3)
list_item_3 = ListItem(List=text_split_3, Index=1, Wrap=True)  # -> simplify(Item)
panel_7 = Panel(list_item_3)
replace_text_5 = ReplaceText(Text=panel_6, Find="{data}", Replace=value_list_3, RecursiveReplace=False)
replace_text_6 = ReplaceText(Text=replace_text_5, Find="{pod}", Replace=panel_7, RecursiveReplace=False)

value_list_4 = ValueList({"wifi", "lux", "temp", "humid", "gas", "noise"}, selected="temp")
annotation_dot_4 = AnnotationDot([<annotation dot referenced from the Rhino model> x13])
panel_8 = Panel("https://io.adafruit.com/api/v2/typevoid/feeds/voidsense{pod}.sense{pod}-{data}/data/chart")
text_split_4 = TextSplit(Text=annotation_dot_4, Separators="()")
point_4 = Point(annotation_dot_4)
list_item_4 = ListItem(List=text_split_4, Index=1, Wrap=True)  # -> simplify(Item)
panel_9 = Panel(list_item_4)
replace_text_7 = ReplaceText(Text=panel_8, Find="{data}", Replace=value_list_4, RecursiveReplace=False)
replace_text_8 = ReplaceText(Text=replace_text_7, Find="{pod}", Replace=panel_9, RecursiveReplace=False)

value_list_5 = ValueList({"wifi", "lux", "temp", "humid", "gas", "noise"}, selected="humid")
annotation_dot_5 = AnnotationDot([<annotation dot referenced from the Rhino model> x13])
panel_10 = Panel("https://io.adafruit.com/api/v2/typevoid/feeds/voidsense{pod}.sense{pod}-{data}/data/chart")
text_split_5 = TextSplit(Text=annotation_dot_5, Separators="()")
point_5 = Point(annotation_dot_5)
list_item_5 = ListItem(List=text_split_5, Index=1, Wrap=True)  # -> simplify(Item)
panel_11 = Panel(list_item_5)
replace_text_9 = ReplaceText(Text=panel_10, Find="{data}", Replace=value_list_5, RecursiveReplace=False)
replace_text_10 = ReplaceText(Text=replace_text_9, Find="{pod}", Replace=panel_11, RecursiveReplace=False)

value_list_6 = ValueList({"wifi", "lux", "temp", "humid", "gas", "noise"}, selected="noise")
annotation_dot_6 = AnnotationDot([<annotation dot referenced from the Rhino model> x13])
panel_12 = Panel("https://io.adafruit.com/api/v2/typevoid/feeds/voidsense{pod}.sense{pod}-{data}/data/chart")
text_split_6 = TextSplit(Text=annotation_dot_6, Separators="()")
point_6 = Point(annotation_dot_6)
list_item_6 = ListItem(List=text_split_6, Index=1, Wrap=True)  # -> simplify(Item)
panel_13 = Panel(list_item_6)
replace_text_11 = ReplaceText(Text=panel_12, Find="{data}", Replace=value_list_6, RecursiveReplace=False)
replace_text_12 = ReplaceText(Text=replace_text_11, Find="{pod}", Replace=panel_13, RecursiveReplace=False)

create_query_param = CreateQueryParam(Key="hours", Value="24")
create_query_param_2 = CreateQueryParam(Key="resolution", Value="10")
create_query_param_3 = CreateQueryParam(Key="start_time", Value="2024-10-25T9:30")
create_query_param_4 = CreateQueryParam(Key="end_time", Value="2024-10-25T18:30")

query_param = QueryParam([create_query_param_2, create_query_param_3, create_query_param_4])
url = Text(replace_text_2)
url_2 = Text(replace_text_4)
url_3 = Text(replace_text_6)
url_4 = Text(replace_text_8)
url_5 = Text(replace_text_10)
url_6 = Text(replace_text_12)

get_request = GETRequest(URL=url_3, Params=query_param)  # -> Status, Content, Response
parse_json_string = ParseJSONString(Text=get_request.Content)
get_json_object_key = GetJSONObjectKey(JObject=parse_json_string, Key="data")
format_json_string = FormatJsonString(JSONString=get_request.Content)
read_json_array = ReadJSONArray(Array=get_json_object_key)
read_json_array_2 = ReadJSONArray(Array=read_json_array)
read_json_value = ReadJSONValue(JValue=read_json_array_2)  # -> simplify(AsString), AsNumber, AsBool
list_item_7 = ListItem(List=read_json_value.AsString, Index=1, Wrap=True)
number = Number(expr("Round(x,1)", list_item_7))
trim_tree = TrimTree(Tree=number, Depth=1)
list_item_8 = ListItem(List=trim_tree, Index=0, Wrap=True)

get_request_2 = GETRequest(URL=url_4, Params=query_param)  # -> Status, Content, Response
parse_json_string_2 = ParseJSONString(Text=get_request_2.Content)
get_json_object_key_2 = GetJSONObjectKey(JObject=parse_json_string_2, Key="data")
format_json_string_2 = FormatJsonString(JSONString=get_request_2.Content)
read_json_array_3 = ReadJSONArray(Array=get_json_object_key_2)
read_json_array_4 = ReadJSONArray(Array=read_json_array_3)
read_json_value_2 = ReadJSONValue(JValue=read_json_array_4)  # -> simplify(AsString), AsNumber, AsBool
list_item_9 = ListItem(List=read_json_value_2.AsString, Index=1, Wrap=True)
number_2 = Number(expr("Round(x,1)", list_item_9))
trim_tree_2 = TrimTree(Tree=number_2, Depth=1)
list_item_10 = ListItem(List=trim_tree_2, Index=0, Wrap=True)

get_request_3 = GETRequest(URL=url_5, Params=query_param)  # -> Status, Content, Response
parse_json_string_3 = ParseJSONString(Text=get_request_3.Content)
get_json_object_key_3 = GetJSONObjectKey(JObject=parse_json_string_3, Key="data")
format_json_string_3 = FormatJsonString(JSONString=get_request_3.Content)
read_json_array_5 = ReadJSONArray(Array=get_json_object_key_3)
read_json_array_6 = ReadJSONArray(Array=read_json_array_5)
read_json_value_3 = ReadJSONValue(JValue=read_json_array_6)  # -> simplify(AsString), AsNumber, AsBool
list_item_11 = ListItem(List=read_json_value_3.AsString, Index=1, Wrap=True)
number_3 = Number(expr("Round(x,1)", list_item_11))
trim_tree_3 = TrimTree(Tree=number_3, Depth=1)
list_item_12 = ListItem(List=trim_tree_3, Index=0, Wrap=True)

get_request_4 = GETRequest(URL=url_6, Params=query_param)  # -> Status, Content, Response
parse_json_string_4 = ParseJSONString(Text=get_request_4.Content)
get_json_object_key_4 = GetJSONObjectKey(JObject=parse_json_string_4, Key="data")
format_json_string_4 = FormatJsonString(JSONString=get_request_4.Content)
read_json_array_7 = ReadJSONArray(Array=get_json_object_key_4)
read_json_array_8 = ReadJSONArray(Array=read_json_array_7)
read_json_value_4 = ReadJSONValue(JValue=read_json_array_8)  # -> simplify(AsString), AsNumber, AsBool
list_item_13 = ListItem(List=read_json_value_4.AsString, Index=1, Wrap=True)
number_4 = Number(expr("Round(x,1)", list_item_13))
trim_tree_4 = TrimTree(Tree=number_4, Depth=1)
list_item_14 = ListItem(List=trim_tree_4, Index=0, Wrap=True)

get_request_5 = GETRequest(URL=url, Params=query_param)  # -> Status, Content, Response
parse_json_string_5 = ParseJSONString(Text=get_request_5.Content)
get_json_object_key_5 = GetJSONObjectKey(JObject=parse_json_string_5, Key="data")
format_json_string_5 = FormatJsonString(JSONString=get_request_5.Content)
read_json_array_9 = ReadJSONArray(Array=get_json_object_key_5)
read_json_array_10 = ReadJSONArray(Array=read_json_array_9)
read_json_value_5 = ReadJSONValue(JValue=read_json_array_10)  # -> simplify(AsString), AsNumber, AsBool
list_item_15 = ListItem(List=read_json_value_5.AsString, Index=1, Wrap=True)
number_5 = Number(expr("Round(x,1)", list_item_15))
trim_tree_5 = TrimTree(Tree=number_5, Depth=1)
list_item_16 = ListItem(List=trim_tree_5, Index=0, Wrap=True)

get_request_6 = GETRequest(URL=url_2, Params=query_param)  # -> Status, Content, Response
parse_json_string_6 = ParseJSONString(Text=get_request_6.Content)
get_json_object_key_6 = GetJSONObjectKey(JObject=parse_json_string_6, Key="data")
format_json_string_6 = FormatJsonString(JSONString=get_request_6.Content)
read_json_array_11 = ReadJSONArray(Array=get_json_object_key_6)
read_json_array_12 = ReadJSONArray(Array=read_json_array_11)
read_json_value_6 = ReadJSONValue(JValue=read_json_array_12)  # -> simplify(AsString), AsNumber, AsBool
list_item_17 = ListItem(List=read_json_value_6.AsString, Index=1, Wrap=True)
number_6 = Number(expr("Round(x,1)", list_item_17))
trim_tree_6 = TrimTree(Tree=number_6, Depth=1)
list_item_18 = ListItem(List=trim_tree_6, Index=0, Wrap=True)

panel_14 = Panel(list_item_16)
merge = Merge(
    Data1=simplify(list_item_18),
    Data2=list_item_16,
    Data3=list_item_10,
    Data4=list_item_12,
    Data5=list_item_8,
    Data6=list_item_14)

# ---- group: Extract Censor Data
panel_16 = Panel("https://io.adafruit.com/api/v2/typevoid/feeds/voidsense{{sensorId}}.sense{{sensorId}}-lux/data/chart")
annotation_dot_7 = AnnotationDot([<annotation dot referenced from the Rhino model> x13])
annotation_dot_8 = AnnotationDot(AnnotationDot=annotation_dot_7)  # -> AnnotationDot, Location, PrimaryText, TextHeight
create_query_param_5 = CreateQueryParam(Key="resolution", Value="30")
create_query_param_6 = CreateQueryParam(Key="end_time", Value="2024-10-25T18:30")
create_query_param_7 = CreateQueryParam(Key="start_time", Value="2024-10-25T9:30")
replace_text_13 = ReplaceText(Text=panel_16, Find="{{sensorId}}", Replace=annotation_dot_8.PrimaryText, RecursiveReplace=False)
get_request_7 = GETRequest(URL=replace_text_13, Params=[create_query_param_5, create_query_param_7, create_query_param_6])  # -> Status, Content, Response
parse_json_string_7 = ParseJSONString(Text=get_request_7.Content)
panel_17 = Panel(annotation_dot_8.PrimaryText)
get_json_object_key_7 = GetJSONObjectKey(JObject=parse_json_string_7, Key="data")
read_json_array_13 = ReadJSONArray(Array=get_json_object_key_7)
read_json_array_14 = ReadJSONArray(Array=read_json_array_13)
read_json_value_7 = ReadJSONValue(JValue=read_json_array_14)  # -> AsString, AsNumber, AsBool
panel_18 = Panel(read_json_value_7.AsString)
list_item_19 = ListItem(List=read_json_value_7.AsString, Index="1", Wrap=True)  # -> Item1, Item
trim_tree_7 = TrimTree(Tree=list_item_19.Item, Depth=1)
panel_19 = Panel(trim_tree_7)

# ----
time_slider = Slider(9, range=0..18)

# ---- group: Match Windows to Censors & Assign Keys / Windows
surface = Surface([<surface referenced from the Rhino model> x63])

# ----
list_item_20 = ListItem(List=trim_tree_7, Index=time_slider, Wrap=True)
clean_tree = CleanTree(RemoveNulls=True, RemoveInvalid=True, RemoveEmpty=False, Tree=list_item_20)
list_item_21 = ListItem(List=annotation_dot_7, Index=clean_tree, Wrap=True)  # -> flatten(Item)

# ---- group: Match Windows to Censors & Assign Keys
area = Area(Geometry=surface)  # -> Area, Centroid
closest_point = ClosestPoint(Point=area.Centroid, Cloud=list_item_21)  # -> ClosestPoint, CPIndex, Distance
model_object = ModelObject(Object=annotation_dot_7)  # -> Object, Geometry, Name, Layer, Visibility, Display, Drafting, Render
get_user_value = GetUserValue(Geometry=surface, Key="Lux")
list_item_22 = ListItem(List=annotation_dot_8.PrimaryText, Index=closest_point.CPIndex, Wrap=True)
model_object_2 = ModelObject(Object=surface)  # -> Object, Geometry, Name, Layer, Visibility, Display, Drafting, Render
user_text = UserText(Content=model_object.Object, Keys="Lux", Values=list_item_20, UserTextMode=1)  # -> Content, Keys, Values
point_7 = Point(closest_point.ClosestPoint)
content_cache = ContentCache(Content=user_text.Content)
user_text_2 = UserText(Content=graft(model_object_2.Object), Keys="SensorID", Values=graft(list_item_22), UserTextMode=1)  # -> Content, Keys, Values
panel_20 = Panel(list_item_22)
content_cache_2 = ContentCache(Content=user_text_2.Content)
panel_21 = Panel(list_item_20)

# ---- group: Visualize- Lux levels
division = Division(A=list_item_20, B=Slider(49, range=0..100))
sort_list = SortList(Keys=flatten(division))  # -> Keys, ValuesValuesA
clean_tree_2 = CleanTree(RemoveNulls=True, RemoveInvalid=True, RemoveEmpty=False, Tree=list_item_20)  # -> flatten(Tree)
gradient = Gradient(
    LowerLimit=Slider(0, range=0..100),
    UpperLimit="1200",
    Parameter=flatten(clean_tree_2),
    stops=[0.604: RGB(0, 0, 0), 1: RGB(255, 255, 255), 1: RGB(0, 0, 0), 1: RGB(255, 255, 255), 1: RGB(0, 0, 0), 1: RGB(0, 0, 0), 1: RGB(255, 255, 255), 1: RGB(255, 255, 255), 1: RGB(0, 0, 0)])
circle = Circle(Plane=annotation_dot_8.Location, Radius=flatten(division))
define_hatch = DefineHatch(Curve=circle, Pattern="Solid", Rotation=0, Scale=1)
custom_preview = CustomPreview(Geometry=define_hatch, Material=gradient)

# ---- group: Visualize - Lux Tag
round = Round(Number=list_item_20)  # -> Nearest, Floor, Ceiling
number_slider = Slider(1.5, range=0..10)
concatenate = Concatenate(FragmentA="Lux: ", FragmentB=round.Nearest)
list_item_23 = ListItem(List=flatten(list_item_19.Item1), Index=time_slider, Wrap=True)
point_8 = Point(Point(-749.4992547, -1662.729111, -2735.68677))
text_tag_3d = TextTag3D(Location=point_8, Text=list_item_23, Size=number_slider, Justification=5)

# ---- group: Visualize - Time of Day Tag
unit_y = UnitY(Factor=Slider(1.5, range=0..10))
move = Move(Geometry=annotation_dot_8.Location, Motion=unit_y)  # -> Geometry, Transform
text_tag_3d_2 = TextTag3D(Location=move.Geometry, Text=flatten(concatenate), Size=number_slider, Justification=7)

# ----
panel_22 = Panel(list_item_19.Item1)
