# Grasshopper definition ChicagoInnovateHackathon_PullSensorData_NoNulls_TEMP.ghx (Grasshopper 1.0.8)
# Copyright: Arup
# plug-ins: eleFront, Swiftlet

# ---- group: Extract Censor Data
panel = Panel("https://io.adafruit.com/api/v2/typevoid/feeds/voidsense{{sensorId}}.sense{{sensorId}}-temp/data/chart")
annotation_dot = AnnotationDot([<annotation dot referenced from the Rhino model> x13])
annotation_dot_2 = AnnotationDot(AnnotationDot=annotation_dot)  # -> AnnotationDot, Location, PrimaryText, TextHeight
create_query_param = CreateQueryParam(Key="resolution", Value="30")
create_query_param_2 = CreateQueryParam(Key="end_time", Value="2024-10-25T18:30")
create_query_param_3 = CreateQueryParam(Key="start_time", Value="2024-10-25T9:30")
replace_text = ReplaceText(Text=panel, Find="{{sensorId}}", Replace=annotation_dot_2.PrimaryText, RecursiveReplace=False)
get_request = GETRequest(URL=replace_text, Params=[create_query_param, create_query_param_3, create_query_param_2])  # -> Status, Content, Response
parse_json_string = ParseJSONString(Text=get_request.Content)
panel_2 = Panel(annotation_dot_2.PrimaryText)
get_json_object_key = GetJSONObjectKey(JObject=parse_json_string, Key="data")
read_json_array = ReadJSONArray(Array=get_json_object_key)
read_json_array_2 = ReadJSONArray(Array=read_json_array)
read_json_value = ReadJSONValue(JValue=read_json_array_2)  # -> AsString, AsNumber, AsBool
panel_3 = Panel(read_json_value.AsString)
list_item = ListItem(List=read_json_value.AsString, Index="1", Wrap=True)  # -> Item1, Item
trim_tree = TrimTree(Tree=list_item.Item, Depth=1)
panel_4 = Panel(trim_tree)

# ----
time_slider = Slider(15, range=0..18)

# ---- group: Match Windows to Censors & Assign Keys / Windows
surface = Surface([<surface referenced from the Rhino model> x63])

# ----
list_item_2 = ListItem(List=trim_tree, Index=time_slider, Wrap=True)
clean_tree = CleanTree(RemoveNulls=True, RemoveInvalid=True, RemoveEmpty=False, Tree=list_item_2)
list_item_3 = ListItem(List=annotation_dot, Index=clean_tree, Wrap=True)  # -> flatten(Item)

# ---- group: Match Windows to Censors & Assign Keys
area = Area(Geometry=surface)  # -> Area, Centroid
closest_point = ClosestPoint(Point=area.Centroid, Cloud=list_item_3)  # -> ClosestPoint, CPIndex, Distance
model_object = ModelObject(Object=annotation_dot)  # -> Object, Geometry, Name, Layer, Visibility, Display, Drafting, Render
get_user_value = GetUserValue(Geometry=surface, Key="Lux")
list_item_4 = ListItem(List=annotation_dot_2.PrimaryText, Index=closest_point.CPIndex, Wrap=True)
model_object_2 = ModelObject(Object=surface)  # -> Object, Geometry, Name, Layer, Visibility, Display, Drafting, Render
user_text = UserText(Content=model_object.Object, Keys="Lux", Values=list_item_2, UserTextMode=1)  # -> Content, Keys, Values
point = Point(closest_point.ClosestPoint)
content_cache = ContentCache(Content=user_text.Content)
user_text_2 = UserText(Content=graft(model_object_2.Object), Keys="SensorID", Values=graft(list_item_4), UserTextMode=1)  # -> Content, Keys, Values
panel_5 = Panel(list_item_4)
content_cache_2 = ContentCache(Content=user_text_2.Content)
panel_6 = Panel(list_item_2)

# ---- group: Visualize- Temp levels
division = Division(A=list_item_2, B=Slider(14, range=0..100))
sort_list = SortList(Keys=flatten(division))  # -> Keys, ValuesValuesA
clean_tree_2 = CleanTree(RemoveNulls=True, RemoveInvalid=True, RemoveEmpty=False, Tree=list_item_2)  # -> flatten(Tree)
gradient = Gradient(
    LowerLimit="90",
    UpperLimit=Slider(70, range=0..100),
    Parameter=flatten(clean_tree_2),
    stops=[0: RGB(234, 38, 0), 0.25: RGB(234, 126, 0), 0.5: RGB(254, 244, 84), 0.75: RGB(173, 203, 249), 1: RGB(75, 107, 169)])
circle = Circle(Plane=annotation_dot_2.Location, Radius=flatten(division))
define_hatch = DefineHatch(Curve=circle, Pattern="Solid", Rotation=0, Scale=1)
custom_preview = CustomPreview(Geometry=define_hatch, Material=gradient)

# ---- group: Visualize - Temp Tag
round = Round(Number=list_item_2)  # -> Nearest, Floor, Ceiling
number_slider = Slider(1.5, range=0..10)
concatenate = Concatenate(FragmentA=round.Nearest, FragmentB=" F")
list_item_5 = ListItem(List=flatten(list_item.Item1), Index=time_slider, Wrap=True)
point_2 = Point(Point(-749.4992547, -1662.729111, -2735.68677))
text_tag_3d = TextTag3D(Location=point_2, Text=list_item_5, Size=number_slider, Justification=5)

# ---- group: Visualize - Time of Day Tag
unit_y = UnitY(Factor=Slider(1.5, range=0..10))
move = Move(Geometry=annotation_dot_2.Location, Motion=unit_y)  # -> Geometry, Transform
text_tag_3d_2 = TextTag3D(Location=move.Geometry, Text=flatten(concatenate), Size=number_slider, Justification=7)

# ----
panel_7 = Panel(list_item.Item1)
