# Grasshopper definition FUN FACADE.ghx (Grasshopper 1.0.8)
# plug-ins: RhinoCodePluginGH, Swiftlet

number_slider = Slider(1, range=0..1)
number_slider_2 = Slider(5.1, range=0.5..10)
unit_y = UnitY(Factor=1)
point = Point(Point(0, 0, 0))
curve = Curve(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)
line_sdl = LineSDL(Start=point, Direction=unit_y, Length=Slider(0.9, range=0..10))
offset_curve = OffsetCurve(Curve=curve, Distance=Slider(3, range=0..3), Corners=1)
division = Division(A="1", B="2")
unit_z = UnitZ(Factor=Slider(4, range=0..10))
unit_z_2 = UnitZ(Factor=Slider(9, range=0..100))
multiplication = Multiplication(A=division, B=number_slider_2)
curve_middle = CurveMiddle(Curve=line_sdl)
length = Length(Curve=offset_curve)
division_2 = Division(A=length, B=number_slider_2)
move = Move(Geometry=line_sdl, Motion=unit_z)  # -> Geometry, Transform
rotate_3d = Rotate3D(Geometry=line_sdl, Angle=degrees(Slider(0, range=0..100)), Center=curve_middle, Axis=Vector(0, 0, 1))  # -> Geometry, Transform
series = Series(Start=0, Step=number_slider_2, Count=division_2)
evaluate_curve = EvaluateCurve(Curve=offset_curve, Parameter=series)  # -> Point, Tangent, Angle
curve_middle_2 = CurveMiddle(Curve=move.Geometry)
rotate_3d_2 = Rotate3D(Geometry=move.Geometry, Angle=degrees(Slider(90, range=0..100)), Center=curve_middle_2, Axis=Vector(0, 0, 1))  # -> Geometry, Transform
multiplication_2 = Multiplication(A=evaluate_curve.Tangent, B=number_slider_2)
unit_y_2 = UnitY(Factor=Slider(1, range=0..1))
loft = Loft(
    Curves=[rotate_3d_2.Geometry, rotate_3d.Geometry],
    Options={Adjust=False, Closed=False, LoftEnds=0, LoftSimp=0, LoftType=0, Rebuild=10, Refit=0.01})
move_2 = Move(Geometry=evaluate_curve.Point, Motion=multiplication_2)  # -> Geometry, Transform
linear_array = LinearArray(Geometry=loft, Direction=unit_y_2, Count=Slider(10, range=0..10))  # -> graft(Geometry), Transform
line_sdl_2 = LineSDL(Start=move_2.Geometry, Direction=expr("-x", evaluate_curve.Tangent), Length=number_slider_2)  # -> simplify(graft(Line))
galapagos = Galapagos(gene=number_slider_2)
move_3 = Move(Geometry=line_sdl_2, Motion=unit_z_2)  # -> simplify(Geometry), Transform
bounding_box = BoundingBox(Content=curve, Plane=PlaneXY(0, 0, 0))  # -> Box, Box_2
evaluate_curve_2 = EvaluateCurve(Curve=reparameterize(line_sdl_2), Parameter="0.5")  # -> Point, Tangent, Angle
evaluate_curve_3 = EvaluateCurve(Curve=reparameterize(move_3.Geometry), Parameter="0.5")  # -> Point, Tangent, Angle

range = Range(Domain="5 to 22", Steps="17")
Y = UnitY(Factor=1)
slider = Slider(8, range=0..24)
Z = UnitZ(Factor=1)
sun_angles = CSharpScript(
    GMT=Slider(18, range=0..23),
    Hour=range,
    DayOfMonth=Slider(8, range=0..31),
    Month=Slider(3, range=0..31),
    Year=Slider(2019, range=1970..2050),
    Latitude="41.878113",
    Longitude="-87.629799",
    North=Y,
    Up=Z,
    DataComparison="cross_reference")  # -> out, azimuth, altitude, direction; inputs GMT: Int32, Hour: Int32, DayOfMonth: Int32, Month: Int32, Year: Int32, Latitude: Double, Longitude: Double, North: Vector3d, Up: Vector3d
# ---------- sun_angles: C# ----------
    // Implementation in C# by Mikael Nillsson
    // http://guideving.blogspot.nl/2010/08/sun-position-in-c.html
    // Adaptation to Grasshopper By Arend van Waart <Arendvw@gmail.com>
    // @see http://stackoverflow.com/questions/8708048/position-of-the-sun-given-time-of-day-latitude-and-longitude

    North.Unitize();
    Up.Unitize();


    DateTime time = new DateTime(Year, Month, DayOfMonth, Hour, 0, 0, DateTimeKind.Utc);
    time = time.AddHours(-GMT);
    this.CalculateSunPosition(time, Latitude, Longitude);
    azimuth = this.azimuth;
    altitude = this.altitude;

    // plane: x = north; y = up
    Point3d p0 = new Point3d(0, 0, 0);
    Point3d p1 = new Point3d(1, 0, 0);
    p1.Transform(Transform.Translation(North));
    p1.Transform(Transform.Rotation(this.azimuth, Up, p0));

    Plane azPlane = new Plane(p0, new Vector3d(p1), Up);
    p1.Transform(Transform.Rotation(this.altitude, azPlane.ZAxis, p0));
    Vector3d dir = new Vector3d(p1);
    dir.Unitize();
    direction = dir;
# ---------- sun_angles: C# additional code ----------
  private const double Deg2Rad = Math.PI / 180.0;
  private const double Rad2Deg = 180.0 / Math.PI;
  private double altitude;
  private double azimuth;

    /*!
     * \brief Calculates the sun light.
     *
     * CalcSunPosition calculates the suns "position" based on a
     * given date and time in local time, latitude and longitude
     * expressed in decimal degrees. It is based on the method
     * found here:
     * http://www.astro.uio.no/~bgranslo/aares/calculate.html
     * The calculation is only satisfiably correct for dates in
     * the range March 1 1900 to February 28 2100.
     * \param dateTime Time and date in local time.
     * \param latitude Latitude expressed in decimal degrees.
     * \param longitude Longitude expressed in decimal degrees.
     */
  public void CalculateSunPosition(
    DateTime dateTime, double latitude, double longitude)
  {
    // Convert to UTC
    dateTime = dateTime.ToUniversalTime();

    // Number of days from J2000.0.
    double julianDate = 367 * dateTime.Year -
      (int) ((7.0 / 4.0) * (dateTime.Year +
      (int) ((dateTime.Month + 9.0) / 12.0))) +
      (int) ((275.0 * dateTime.Month) / 9.0) +
      dateTime.Day - 730531.5;

    double julianCenturies = julianDate / 36525.0;

    // Sidereal Time
    double siderealTimeHours = 6.6974 + 2400.0513 * julianCenturies;

    double siderealTimeUT = siderealTimeHours +
      (366.2422 / 365.2422) * (double) dateTime.TimeOfDay.TotalHours;

    double siderealTime = siderealTimeUT * 15 + longitude;

    // Refine to number of days (fractional) to specific time.
    julianDate += (double) dateTime.TimeOfDay.TotalHours / 24.0;
    julianCenturies = julianDate / 36525.0;

    // Solar Coordinates
    double meanLongitude = CorrectAngle(Deg2Rad *
      (280.466 + 36000.77 * julianCenturies));

    double meanAnomaly = CorrectAngle(Deg2Rad *
      (357.529 + 35999.05 * julianCenturies));

    double equationOfCenter = Deg2Rad * ((1.915 - 0.005 * julianCenturies) *
      Math.Sin(meanAnomaly) + 0.02 * Math.Sin(2 * meanAnomaly));

    double elipticalLongitude =
      CorrectAngle(meanLongitude + equationOfCenter);

    double obliquity = (23.439 - 0.013 * julianCenturies) * Deg2Rad;

    // Right Ascension
    double rightAscension = Math.Atan2(
      Math.Cos(obliquity) * Math.Sin(elipticalLongitude),
      Math.Cos(elipticalLongitude));

    double declination = Math.Asin(
      Math.Sin(rightAscension) * Math.Sin(obliquity));

    // Horizontal Coordinates
    double hourAngle = CorrectAngle(siderealTime * Deg2Rad) - rightAscension;

    if (hourAngle > Math.PI)
    {
      hourAngle -= 2 * Math.PI;
    }

    this.altitude = Math.Asin(Math.Sin(latitude * Deg2Rad) *
      Math.Sin(declination) + Math.Cos(latitude * Deg2Rad) *
      Math.Cos(declination) * Math.Cos(hourAngle));

    // Nominator and denominator for calculating Azimuth
    // angle. Needed to test which quadrant the angle is in.
    double aziNom = -Math.Sin(hourAngle);
    double aziDenom =
      Math.Tan(declination) * Math.Cos(latitude * Deg2Rad) -
      Math.Sin(latitude * Deg2Rad) * Math.Cos(hourAngle);

    this.azimuth = Math.Atan(aziNom / aziDenom);

    if (aziDenom < 0) // In 2nd or 3rd quadrant
    {
      this.azimuth += Math.PI;
    }
    else if (aziNom < 0) // In 4th quadrant
    {
      this.azimuth += 2 * Math.PI;
    }

    // Altitude
    //Console.WriteLine("Altitude: " + altitude * Rad2Deg);

    // Azimut
    //Console.WriteLine("Azimuth: " + azimuth * Rad2Deg);
  }

    /*!
    * \brief Corrects an angle.
    *
    * \param angleInRadians An angle expressed in radians.
    * \return An angle in the range 0 to 2*PI.
    */
  private static double CorrectAngle(double angleInRadians)
  {
    if (angleInRadians < 0)
    {
      return 2 * Math.PI - (Math.Abs(angleInRadians) % (2 * Math.PI));
    }
    else if (angleInRadians > 2 * Math.PI)
    {
      return angleInRadians % (2 * Math.PI);
    }
    else
    {
      return angleInRadians;
    }
  }
# ---------- end sun_angles ----------

rotate = Rotate(Geometry=line_sdl_2, Angle=degrees(1.570796327), Plane=evaluate_curve_2.Point)  # -> Geometry, Transform
panel = Panel("https://api.tomorrow.io/v4/timelines?location={{location}}&fields=temperature&startTime={{startTime}}&endTime={{endTime}}&timesteps=1h&units=metric&timezone={{timezone}}")  # disabled
rotate_2 = Rotate(Geometry=move_3.Geometry, Angle=degrees(1.570796327), Plane=evaluate_curve_3.Point)  # -> Geometry, Transform
evaluate_box = EvaluateBox(Box=bounding_box.Box, UParameter="0.5", VParameter="0.5", WParameter="0.5")  # -> Plane, Point, Include
python_3_script = Python3Script(x=panel, lat="41.878113", long="-87.629799")  # -> out, a; inputs lat: String; disabled; unedited script template

deg = Degrees(Radians=sun_angles.azimuth)
deg_2 = Degrees(Radians=sun_angles.altitude)
line = LineSDL(Start=evaluate_box.Point, Direction=Y, Length=Slider(202, range=0..1000))
rot3d = Rotate3D(Geometry=line, Angle=expr("-x", degrees(deg)), Center=evaluate_box.Point, Axis=Vector(0, 0, 1))  # -> Geometry, Transform
tan = Tangent(Value=degrees(deg_2))
len = Length(Curve=rot3d.Geometry)
multiplication_3 = Multiplication(A=tan, B=len)
end = EndPoints(Curve=rot3d.Geometry)  # -> Start, End
Z_2 = UnitZ(Factor=multiplication_3)
num = Number("250")
move_4 = Move(Geometry=end.End, Motion=Z_2)  # -> Geometry, Transform
ln = Line(StartPoint=end.Start, EndPoint=move_4.Geometry)
division_3 = Division(A=num, B="40")
end_2 = EndPoints(Curve=ln)  # -> Start, End
sph = Sphere(Base=move_4.Geometry, Radius=division_3)
ln_2 = Line(StartPoint=end.End, EndPoint=end_2.End)
end_3 = EndPoints(Curve=ln_2)  # -> Start, End
intcrv = Interpolate(Vertices=end_3.Start, Degree=3, Periodic=False, KnotStyle=1)  # -> Curve, Length, Domain
intcrv_2 = Interpolate(Vertices=end_3.End, Degree=3, Periodic=False, KnotStyle=1)  # -> Curve, Length, Domain

distance = Distance(PointA=flatten(evaluate_curve_3.Point), PointB=flatten(move_4.Geometry))
py = Python3Script(x=distance)  # -> out, a; inputs x: list
# ---------- py: Python ----------
"""Grasshopper Script"""
a = min(x)
# ---------- end py ----------
py_2 = Python3Script(x=distance)  # -> out, a; inputs x: list
# ---------- py_2: Python ----------
"""Grasshopper Script"""
a = max(x)
# ---------- end py_2 ----------
construct_domain = ConstructDomain(DomainStart=py.a, DomainEnd=py_2.a)
remap_numbers = RemapNumbers(Value=distance, Source=construct_domain, Target="0 To 90")  # -> Mapped, Clipped
c_script = CSharpScript(top=remap_numbers.Mapped, bottom=remap_numbers.Mapped)  # -> out, a; inputs top: Double, bottom: Double
# ---------- c_script: C# ----------
// Grasshopper Script Instance
#region Usings
using System;
using System.Linq;
using System.Collections;
using System.Collections.Generic;
using System.Drawing;

using Rhino;
using Rhino.Geometry;

using Grasshopper;
using Grasshopper.Kernel;
using Grasshopper.Kernel.Data;
using Grasshopper.Kernel.Types;
#endregion

public class Script_Instance : GH_ScriptInstance
{
    #region Notes
    /* 
      Members:
        RhinoDoc RhinoDocument
        GH_Document GrasshopperDocument
        IGH_Component Component
        int Iteration

      Methods (Virtual & overridable):
        Print(string text)
        Print(string format, params object[] args)
        Reflect(object obj)
        Reflect(object obj, string method_name)
    */
    #endregion

    private void RunScript(double top, double bottom, ref object a)
    {
        double t = top;
        double b = bottom;
        a =  100 - 50 * ((t / 90) + (b / 90));
    }
}
# ---------- end c_script ----------
panel_2 = Panel(c_script.a)
rotate_3 = Rotate(Geometry=rotate_2.Geometry, Angle=graft(degrees(remap_numbers.Mapped)), Plane=evaluate_curve_3.Point)  # -> Geometry, Transform
rotate_4 = Rotate(Geometry=rotate.Geometry, Angle=graft(degrees(remap_numbers.Mapped)), Plane=evaluate_curve_3.Point)  # -> Geometry, Transform
py_3 = Python3Script(x=c_script.a)  # -> out, a, b; inputs x: list of Double
# ---------- py_3: Python ----------
"""Grasshopper Script"""
a = "Hello Python 3 in Grasshopper!"
a = sum(x)
b = len(x) * 100
# ---------- end py_3 ----------
geometry = Geometry([<surface referenced from the Rhino model> x47])
loft_2 = Loft(
    Curves=[rotate_4.Geometry, rotate_3.Geometry],
    Options={Adjust=False, Closed=False, LoftEnds=0, LoftSimp=0, LoftType=0, Rebuild=10, Refit=0.01})  # -> simplify(Loft)
get_request = GETRequest(URL=python_3_script.a)  # -> Status, Content, Response; disabled
cir = Circle(Plane=PlaneXY(0, 0, 0), Radius="250")
surface = Surface(simplify(geometry))
panel_3 = Panel(py_3.a)
panel_4 = Panel(py_3.b)
random = Random(Range=flatten("0 To 90"), Number=flatten(remap_numbers.Mapped), Seed=2)  # -> flatten(Random); disabled
bounding_box_2 = BoundingBox(Content=loft_2, Plane=PlaneXY(0, 0, 0))  # -> Box, Box_2
srf = Surface(cir)
area = Area(Geometry=surface)  # -> Area, Centroid
evaluate_box_2 = EvaluateBox(Box=bounding_box_2.Box, UParameter="0.5", VParameter="0.5", WParameter="0.5")  # -> Plane, Point, Include
division_4 = Division(A=panel_3, B=panel_4)
py_4 = Python3Script(x=area.Area)  # -> out, a; inputs x: list of Double
# ---------- py_4: Python ----------
"""Grasshopper Script"""
a = "Hello Python 3 in Grasshopper!"
a = sum(x)
# ---------- end py_4 ----------
multiplication_4 = Multiplication(A=py_4.a, B=division_4)
unit_x = UnitX(Factor=1)
panel_5 = Panel(division_4)
panel_6 = Panel(multiplication_4)
panel_7 = Panel(py_4.a)
list_item = ListItem(List=ln, Index=Slider(1, range=1..14), Wrap=True)
angle = Angle(VectorA=list_item, VectorB=flatten(unit_x))  # -> Angle, Reflex
rotate_5 = Rotate(Geometry=flatten(loft_2), Angle=angle.Angle, Plane=flatten(evaluate_curve_2.Point))  # -> Geometry, Transform
degrees = Degrees(Radians=angle.Angle)
panel_8 = Panel(degrees)
